# Grasshopper definition OpenNestExample191004.gh (Grasshopper 1.0.7)
# plug-ins: OpenNest

# ----
# If you want to unroll simple geometry
brep = Brep([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])  # disabled
unroll = Unroll(MeshOrBrep=brep)  # -> Brep, Curves, Points, TextDotsLocation, TextDots; disabled

# ----
# Text for engraving
pop2d = Populate2D(Region={Plane=PlaneXY(0, 0, 0), Size=Domain2(u=0..20, v=0..10)}, Count=100, Seed=1)  # disabled
pdecon = Deconstruct(Point=pop2d)  # -> XComponent, YComponent, ZComponent; disabled
round = Round(Number=pdecon.XComponent)  # -> Nearest, Floor, Ceiling; disabled
text = Text(Location=pop2d, Text=round.Nearest, Size=1)  # disabled

# ---- group: This projects polygons to plane
crv = Curve([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])
project = Project(Polyline=crv)  # -> Polyline, Plane
pack = PackObjects(Geo=project.Polyline, Plane=project.Plane, X=1, Y=1, Tolerabce=3.14)  # -> Geo, Transformation

# ----
# If you just want to pack object into rectangle array
pln = Plane([Plane(origin=(177.2966553, -26.65196411, 44.30150529), x=(0, -1, 0), y=(-1, 0, 0)), Plane(origin=(236.1676684, -43.9024936, 40.92366467), x=(-0.4373626862, 0, -0.8992852054), y=(0, -1, 0)), Plane(origin=(206.5526304, -164.2693558, 0), x=(-0.7706951683, -0.6372040156, 0), y=(0.6372040156, -0.7706951683, 0)), Plane(origin=(268.3124917, -156.3636782, 0), x=(0.7372204611, 0.6756522713, 0), y=(0.6756522713, -0.7372204611, 0))])  # disabled
# Some additional helpers:
geo = Geometry([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])  # disabled
number_slider = Slider(8, range=0..100)  # disabled
number_slider_2 = Slider(53, range=0..100)  # disabled
entwine = Entwine(Branch00=pln, Branch01=pln, FlattenInputs=True)  # disabled
entwine_2 = Entwine(Branch00=geo, Branch01=geo, FlattenInputs=True)  # disabled
pack_2 = PackObjects(Geo=entwine_2, Plane=entwine, X=number_slider, Y=number_slider_2, Tolerabce=3.14)  # -> Geo, Transformation; disabled

# ----
# Basic Setup
# Nesting Polylines
crv_2 = Curve(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)
opennest = OpenNest(
    Sheets=crv_2,
    Geo=pack.Geo,
    Spacing=1,
    Placement=1,
    Tolerance=0.1,
    Rotations=4,
    Iterations=1,
    Seed=1,
    Reset=True,
    Run=False)  # -> Sheets, Geo, ID, Transform, IDS

# ---- group: This projects polygons to plane
crv_3 = Curve([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])  # disabled
project_2 = Project(Polyline=crv_3)  # -> Polyline, Plane; disabled
pack_3 = PackObjects(Geo=project_2.Polyline, Plane=project_2.Plane, X=1, Y=1, Tolerabce=3.14)  # -> Geo, Transformation; disabled

# ----
# Nesting To Arbitrary Sheets
crv_4 = Curve([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])  # disabled
opennest_2 = OpenNest(
    Sheets=crv_4,
    Geo=pack_3.Geo,
    Spacing=1,
    Placement=1,
    Tolerance=0.1,
    Rotations=4,
    Iterations=1,
    Seed=1,
    Reset=True,
    Run=False)  # -> Sheets, Geo, ID, Transform, IDS; disabled

# ----
# If you want nest rhino objects
# Reference them as guids,
# convert to polylines
# And then press boolean button to bake them
number_slider_3 = Slider(3, range=0..10)  # disabled
id = Guid()  # disabled
crv_5 = Curve(<curve referenced from the Rhino model>)  # disabled
crv_6 = Curve(id)  # disabled
opennest_3 = OpenNest(
    Sheets=crv_5,
    Geo=crv_6,
    Spacing=1,
    Placement=number_slider_3,
    Tolerance=0.1,
    Rotations=4,
    Iterations=1,
    Seed=1,
    Reset=True,
    Run=False)  # -> Sheets, Geo, ID, Transform, IDS; disabled
button = Button()  # disabled
tguid = TransformGuid(Guid=id, Transform=opennest_3.Transform, Run=button)  # disabled

# ----
# Nest Rhino Objects
number_slider_4 = Slider(2, range=0..10)  # disabled
id_2 = Guid()  # disabled
rhinoobjects = RhinoObjects(GeometryAsGuid=id_2, T=number_slider_4)  # -> Breps, GeometryAsGuid; disabled
number_slider_5 = Slider(0.01, range=0..0.01)  # disabled
number_slider_6 = Slider(0.3, range=0..10)  # disabled
crv_7 = Curve(<curve referenced from the Rhino model>)  # disabled
opennest_4 = OpenNest(
    Sheets=crv_7,
    Geo=rhinoobjects.Breps,
    Spacing=number_slider_6,
    Placement=1,
    Tolerance=number_slider_5,
    Rotations=4,
    Iterations=1,
    Seed=1,
    Reset=True,
    Run=False)  # -> Sheets, Geo, ID, Transform, IDS; disabled
id_3 = Guid(rhinoobjects.GeometryAsGuid)  # disabled
button_2 = Button()  # disabled
tguid_2 = TransformGuid(Guid=id_3, Transform=graft(opennest_4.Transform), Run=button_2)  # disabled

# ---- group: Parts can be either polylines or planar surfaces
number_slider_7 = Slider(100, range=0..100)  # disabled
number_slider_8 = Slider(2, range=0..10)  # disabled
crv_8 = Curve([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])  # disabled
boundary = BoundarySurfaces(Edges=crv_8)  # disabled
crv_9 = Curve(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)  # disabled
repeat = RepeatData(Data=boundary, Length=number_slider_8)  # disabled
repeat_2 = RepeatData(Data=crv_9, Length=number_slider_7)  # disabled
merge = Merge(Data1=repeat, Data2=repeat_2)  # -> flatten(Result); disabled

# ----
# Nesting Shape with Holes -> Planar Surfaces
crv_10 = Curve(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)  # disabled
area = Area(Geometry=merge)  # -> Area, Centroid; disabled
number_slider_9 = Slider(2, range=0..10)  # disabled
lng = ListLength(List=area.Centroid)  # disabled
opennest_5 = OpenNest(
    Sheets=crv_10,
    Geo=merge,
    Spacing=1,
    Placement=1,
    Tolerance=0.1,
    Rotations=4,
    Iterations=1,
    Seed=1,
    Reset=True,
    Run=False)  # -> Sheets, Geo, ID, Transform, IDS; disabled
series = Series(Start=0, Step=1, Count=lng)  # disabled
int = Integer(series)  # disabled
text_2 = Text(Location=area.Centroid, Text=int, Size=number_slider_9)  # disabled
group = Group(Objects=text_2)  # -> flatten(Group); disabled

# ---- group: If you want to nest additional goemetry
transform = Transform(Geometry=group, Transform=opennest_5.Transform)  # disabled

# ----
# Unroll + Nest
brep_2 = Brep([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])  # disabled
area_2 = Area(Geometry=brep_2)  # -> Area, Centroid; disabled
unroll_2 = Unroll(MeshOrBrep=brep_2, Points=area_2.Centroid)  # -> flatten(Brep), Curves, flatten(Points), TextDotsLocation, TextDots; disabled
number_slider_10 = Slider(0, range=0..100)  # disabled
crv_11 = Curve(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)  # disabled
opennest_6 = OpenNest(
    Sheets=crv_11,
    Geo=unroll_2.Brep,
    Spacing=number_slider_10,
    Placement=1,
    Tolerance=0.1,
    Rotations=4,
    Iterations=1,
    Seed=1,
    Reset=True,
    Run=False)  # -> Sheets, Geo, ID, Transform, IDS; disabled
transform_2 = Transform(Geometry=unroll_2.Points, Transform=opennest_6.Transform)  # disabled
points = PointList(Points=transform_2, Size=2)  # disabled

# ----
# Nesting Curves
# Internally component converts curves to polylines.
# Suggestion to convert to polylines.
number_slider_11 = Slider(30, range=0..100)  # disabled
toggle = BooleanToggle(True)  # disabled
toggle_2 = BooleanToggle(True)  # disabled
number_slider_12 = Slider(0.1, range=0..0.1)  # disabled
number_slider_13 = Slider(1, range=0..100)  # disabled
number_slider_14 = Slider(5, range=0..10)  # disabled
number_slider_15 = Slider(4, range=0..5)  # disabled
number_slider_16 = Slider(4, range=0..10000)  # disabled
number_slider_17 = Slider(1, range=0..100)  # disabled
number_slider_18 = Slider(2, range=0..10)  # disabled
crv_12 = Curve([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])  # disabled
repeat_3 = RepeatData(Data=crv_12, Length=number_slider_11)  # disabled
crv_13 = Curve(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)  # disabled
opennest_7 = OpenNest(
    Sheets=crv_13,
    Geo=repeat_3,
    Spacing=number_slider_13,
    Placement=number_slider_15,
    Tolerance=number_slider_12,
    Rotations=number_slider_16,
    Iterations=number_slider_17,
    Seed=number_slider_18,
    Reset=toggle,
    Run=toggle_2)  # -> Sheets, Geo, ID, Transform, IDS; disabled

# ----
# Nesting Breps and Meshes
toggle_3 = BooleanToggle(True)  # disabled
toggle_4 = BooleanToggle(True)  # disabled
number_slider_19 = Slider(0.1, range=0..0.1)  # disabled
number_slider_20 = Slider(1, range=0..100)  # disabled
number_slider_21 = Slider(5, range=0..10)  # disabled
number_slider_22 = Slider(4, range=0..5)  # disabled
number_slider_23 = Slider(4, range=0..10000)  # disabled
number_slider_24 = Slider(1, range=0..100)  # disabled
number_slider_25 = Slider(2, range=0..10)  # disabled
geo_2 = Geometry([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])  # disabled
crv_14 = Curve(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)  # disabled
crv_15 = Curve([<curve referenced from the Rhino model> x2])  # disabled
opennest_8 = OpenNest(
    Sheets=crv_14,
    Geo=geo_2,
    Spacing=number_slider_20,
    Placement=number_slider_22,
    Tolerance=number_slider_19,
    Rotations=number_slider_23,
    Iterations=number_slider_24,
    Seed=number_slider_25,
    Reset=toggle_3,
    Run=toggle_4)  # -> Sheets, Geo, ID, Transform, IDS; disabled

# ---- group: Must be set to 0 to run live
number_slider_26 = Slider(0, range=0..100)  # disabled

# ----
# Running Solver Iteratively.
# Only the most optimcal results
# are outputed
button_3 = Button()  # disabled
toggle_5 = BooleanToggle(False)  # disabled
crv_16 = Curve(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)  # disabled
crv_17 = Curve([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])  # disabled
opennest_9 = OpenNest(
    Sheets=crv_16,
    Geo=crv_17,
    Spacing=1,
    Placement=1,
    Tolerance=0.1,
    Rotations=4,
    Iterations=number_slider_26,
    Seed=1,
    Reset=button_3,
    Run=toggle_5)  # -> Sheets, Geo, ID, Transform, IDS; disabled
