# Grasshopper definition OpenNestExample.gh (Grasshopper 1.0.7)
# plug-ins: OpenNest

crv = Curve(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)
repeat = RepeatData(Data=crv, Length=Slider(5, range=0..10))
crv_2 = Curve([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])

opennest = OpenNest(Sheets=repeat, Polylines=crv_2, Spacing=Slider(0, range=0..100), Iterations=Slider(1, range=0..4))  # -> Sheets, Polylines, ID, Transform
group = Group(Objects=Tree({0;0;0;0}: [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], {0;0;0;1}: [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], {0;0;0;2}: [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], {0;0;0;3}: [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], {0;0;0;4}: [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], {0;0;0;5}: [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]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))  # -> flatten(Group)

# ---- group: If you want to nest additional goemetry
transform = Transform(Geometry=group, Transform=opennest.Transform)

# ----
item = ListItem(List=opennest.Polylines, Index=Slider(16, range=0..100), Wrap=True)
