# Grasshopper definition geometry.ghx (Grasshopper 1.0.8)
# plug-ins: opennest_2 Info

# ---- group: Attributes Geometries
geo = Geometry(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)
geo_2 = Geometry(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)
geo_3 = Geometry([Point(-811, 529, 0), Point(-713, 532, 0), Point(-716, 471, 0), Point(-751, 448, 0), Point(-808, 450, 0), Point(-803, 490, 0), Point(-772, 515, 0), Point(-731, 498, 0), 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])
entwine = Entwine(Branch00=geo, Branch01=geo_2, Branch02=geo_3, FlattenInputs=True)

# ---- group: Closed outlines (with or without holes)
# Support with a coffee or beer:
# https://ko-fi.com/petrasvestartas
crv = Curve([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])
crv_2 = Curve(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)
crv_3 = Curve(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)
entwine_2 = Entwine(Branch00=crv, Branch01=crv_2, Branch02=crv_3, FlattenInputs=True)

# ----
crv_4 = Curve(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)
sheets = Sheets(Polylines=crv_4, Gap=Slider(10, range=10..100), Rows=Slider(20, range=1..20), Copies=Slider(20, range=1..1000), Offset=0)  # -> Sheets, Polylines

# ---- group: Separate your input to a) closed polylines b) attributes e.g. points, lines, meshes and etc. If attributes are used you must use a data-tree for outlines and attributes.
crv_5 = Curve(entwine_2)
geo_4 = Geometry(entwine)
geometry = Geometry(Outlines=crv_5, Simplify="-100", Hull=Toggle(False), Copies="1", Offset="20", Attributes=geo_4)  # -> Geometry, Borders

# ----
opennest2 = OpenNest2(
    Sheets=sheets.Sheets,
    Geometry=geometry.Geometry,
    Iterations=10,
    Run=Toggle(True),
    opt_all_rotations=1,
    opt_element_holes=1,
    opt_font="MecSoft_Font-1 1",
    opt_mutation=10,
    opt_num_of_rotations=8,
    opt_placement_type=1,
    opt_population=10,
    opt_seed=30,
    opt_spacing=0,
    options_expanded=False)  # -> Sheets, Borders, AllGeometry, Transforms, SheetId, SheetTxt, Attributes
geometry_2 = Geometry(opennest2.Borders)
geometry_3 = Geometry(opennest2.AllGeometry)

# ---- group: Attributes are hidden by default.
geometry_4 = Geometry(opennest2.Attributes)
