# Grasshopper definition geometry_surface.ghx (Grasshopper 1.0.8)
# plug-ins: opennest_2 Info

to_nest = Geometry([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])
srf = Surface(to_nest)
# Support with a coffee or beer:
# https://ko-fi.com/petrasvestartas
crv = Curve(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)
sheets = Sheets(Polylines=crv, Gap=0.1, Offset=0)  # -> Sheets, Polylines
geometry_srf = GeometrySurfaces(Surfaces=srf, Simplify=10, Hull=False, Offset=0)  # -> Geometry, Borders
opennestcollision = OpenNestCollision(
    Sheets=sheets.Sheets,
    Geometry=geometry_srf.Geometry,
    Iterations=Slider(1000, range=0..1000),
    Run=Toggle(False),
    opt_compact=1,
    opt_element_holes=1,
    opt_fit=0,
    opt_font="MecSoft_Font-1 1",
    opt_num_of_rotations=3600,
    opt_poles=48,
    opt_seed=100,
    opt_starts=1,
    options_expanded=False)  # -> Sheets, Borders, AllGeometry, Transforms, SheetId, SheetTxt, Attributes
