# Grasshopper definition inscribed_circle.ghx (Grasshopper 1.0.8)
# plug-ins: opennest_2 Info

# ----
# Inscribe text into a polygon.
# Useful for creating tags.
# Because it is not center of a polygon.
# The algorithm use Polylabel algorithm.
# Curve winding matters.
number_slider = Slider(100, range=0..100)
crv = Curve([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])
# Support with a coffee or beer:
# https://ko-fi.com/petrasvestartas
inscribecircle = InscribeCircle(Polylines=crv, Tolerance=10)
xy = XYPlane(Origin=inscribecircle)
text = Text(Location=xy, Text="BEER", Size=number_slider)
