# Grasshopper definition opennest1.ghx (Grasshopper 1.0.8)
# plug-ins: opennest_2 Info

# ---- group: Static
crv = Curve([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])
project = Project(Polyline=crv)  # -> Polyline, Plane
pack = PackObjects(Geo=project.Polyline, Plane=project.Plane, X=1, Y=1, Tolerance=0)  # -> Geo, Transformation
# Support with a coffee or beer:
# https://ko-fi.com/petrasvestartas
crv_2 = Curve(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)
opennest1 = OpenNest1(
    Sheets=crv_2,
    Geo=pack.Geo,
    Spacing=1,
    Placement=1,
    Tolerance=0.1,
    Rotations=2,
    Iterations=6,
    Seed=1,
    Tries=1,
    Reset=Button(),
    Run=Toggle(True))  # -> Sheets, Geo, ID, Transform, IDS
