# Grasshopper definition opennest2.ghx (Grasshopper 1.0.8)
# plug-ins: opennest_2 Info

crv = Curve(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)
panel = Panel("""1
25
25
25
4""")
crv_2 = Curve(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)
crv_3 = Curve([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])
crv_4 = Curve(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)
crv_5 = Curve(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)
crv_6 = Curve(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)
entwine = Entwine(Branch00=crv_3, Branch01=crv_4, Branch02=crv_5, Branch03=crv_6, Branch04=crv_2, FlattenInputs=True)
# Support with a coffee or beer:
# https://ko-fi.com/petrasvestartas
sheets = Sheets(Polylines=crv, Gap=0.1, Copies=Slider(1, range=0..10), Offset=0)  # -> Sheets, Polylines
geometry = Geometry(Outlines=entwine, Simplify=-100, Hull=False, Copies=panel, Offset=0)  # -> Geometry, Borders
opennest2 = OpenNest2(
    Sheets=sheets.Sheets,
    Geometry=geometry.Geometry,
    Iterations=10,
    Run=Toggle(True),
    opt_all_rotations=1,
    opt_element_holes=1,
    opt_font="MecSoft_Font-1 1",
    opt_mutation=10,
    opt_num_of_rotations=8,
    opt_placement_type=1,
    opt_population=10,
    opt_seed=30,
    opt_spacing=0,
    options_expanded=False)  # -> Sheets, Borders, AllGeometry, Transforms, SheetId, SheetTxt, Attributes
