# Grasshopper definition opennestcollision.ghx (Grasshopper 1.0.8)
# plug-ins: opennest_2 Info

# Support with a coffee or beer:
# https://ko-fi.com/petrasvestartas
rectangle = Rectangle(Plane=PlaneXY(0, 0, 0), XSize=Slider(510, range=0..1201), YSize=Slider(635, range=0..1201), Radius=0)  # -> Rectangle, Length
crv = Curve(Tree({0;0}: [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], {1;0}: [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], {2;0}: [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], {3;0}: [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], {4;0}: [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], {5;0}: [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]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))
geometry = Geometry(Outlines=crv, Simplify=-100, Hull=False, Offset=0)  # -> Geometry, Borders
sheets = Sheets(Polylines=rectangle.Rectangle, Gap=0.1, Offset=0)  # -> Sheets, Polylines
opennestcollision = OpenNestCollision(
    Sheets=sheets.Sheets,
    Geometry=geometry.Geometry,
    Iterations=Slider(10000, range=0..1000000),
    Run=Toggle(False),
    opt_compact=1,
    opt_element_holes=1,
    opt_fit=0,
    opt_font="MecSoft_Font-1 1",
    opt_num_of_rotations=3600,
    opt_poles=48,
    opt_seed=100,
    opt_starts=1,
    options_expanded=True)  # -> Sheets, Borders, AllGeometry, Transforms, SheetId, SheetTxt, Attributes
