# Grasshopper definition rhino_objects.ghx (Grasshopper 1.0.8)
# plug-ins: opennest_2 Info

id = Guid([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])
rhinoobjects = RhinoObjects(GeometryAsGuid=id, T=0.01)  # -> Breps, GeometryAsGuid
# Support with a coffee or beer:
# https://ko-fi.com/petrasvestartas
panel = Panel(rhinoobjects.Breps)
panel_2 = Panel(rhinoobjects.GeometryAsGuid)
