# Grasshopper definition box_packing_2d.ghx (Grasshopper 1.0.8)
# plug-ins: opennest_2 Info

number_slider = Slider(100, range=0..100)
crv = Curve(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)
# Support with a coffee or beer:
# https://ko-fi.com/petrasvestartas
repeat = RepeatData(Data=crv, Length=number_slider)
series = Series(Start=0, Step=1, Count=number_slider)
pop2d = Populate2D(Region=repeat, Count=Slider(10, range=0..10), Seed=series)
hull = ConvexHull(Points=pop2d, Plane=PlaneXY(0, 0, 0))  # -> flatten(Hull), HullZ, Indices

# ----
# Pack Geometry by Transformation matrix, second example.
crv_2 = Curve([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])
packbox = PackingBoxes(Con=crv_2, Geo=hull.Hull)  # -> Geo, Tra
transform = Transform(Geometry=hull.Hull, Transform=packbox.Tra)
