# Grasshopper definition rhino_objects.ghx (Grasshopper 1.0.8)
# plug-ins: opennest_2 Info

id = Guid(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)
# Support with a coffee or beer:
# https://ko-fi.com/petrasvestartas
geometry_rhino = GeometryRhino(Layer="Default", Copies="1", Simplify=[100, 0], Sort=Slider(0, range=-1..1), Offset=0, Guid=id)  # -> Geometry, Borders, BC, Groups, All
