# Grasshopper definition geometry_surface.ghx (Grasshopper 1.0.8)
# plug-ins: opennest_2 Info

to_nest = Geometry([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])
srf = Surface(to_nest)
# Support with a coffee or beer:
# https://ko-fi.com/petrasvestartas
crv = Curve(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)
geometry_srf = GeometrySurfaces(Surfaces=srf, Simplify=10, Hull=False, Offset=0)  # -> Geometry, Borders
sheets = Sheets(Polylines=crv, Gap=0.1, Offset=0)  # -> Sheets, Polylines
opennestcollision = OpenNestCollision(
    Sheets=sheets.Sheets,
    Geometry=geometry_srf.Geometry,
    Iterations=Slider(1000, range=0..1000),
    opt_compact=2,
    opt_element_holes=2,
    opt_fit=1,
    opt_font="MecSoft_Font-1 1",
    opt_num_of_rotations=32,
    opt_poles=64,
    opt_seed=100,
    opt_starts=4,
    options_expanded=True)  # -> Sheets, Borders, AllGeometry, Transforms, SheetId, SheetTxt, Attributes
