# Grasshopper definition merge.ghx (Grasshopper 1.0.8)
# plug-ins: opennest_2 Info

id = Guid([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])
geometry_rhino = GeometryRhino(Layer="a", Copies="2", Simplify=[0, 0], Sort=Slider(0, range=-1..1), Offset=0, Guid=id)  # -> Geometry, Borders, BC, Groups, All

id_2 = Guid([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])
geometry_rhino_2 = GeometryRhino(Layer="b", Copies="1", Simplify=[0, 0], Sort=Slider(0, range=-1..1), Offset=0, Guid=id_2)  # -> Geometry, Borders, BC, Groups, All

# ----
# Support with a coffee or beer:
# https://ko-fi.com/petrasvestartas
crv = Curve(<curve referenced from the Rhino model>)
sheets = Sheets(Polylines=crv, Gap=0.1, Offset=0)  # -> Sheets, Polylines
merge = Merge(Geometry=geometry_rhino.Geometry, Geometry_2=geometry_rhino_2.Geometry)
opennest2 = OpenNest2(
    Sheets=sheets.Sheets,
    Geometry=merge,
    Iterations=10,
    Run=Toggle(False),
    opt_all_rotations=1,
    opt_element_holes=1,
    opt_font="MecSoft_Font-1 1",
    opt_mutation=10,
    opt_num_of_rotations=8,
    opt_placement_type=1,
    opt_population=10,
    opt_seed=30,
    opt_spacing=0,
    options_expanded=False)  # -> Sheets, Borders, AllGeometry, Transforms, SheetId, SheetTxt, Attributes
crv_2 = Curve()
