# Grasshopper definition sheets.ghx (Grasshopper 1.0.8)
# plug-ins: opennest_2 Info

crv = Curve([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])
crv_2 = Curve(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)
crv_3 = Curve([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])
# Support with a coffee or beer:
# https://ko-fi.com/petrasvestartas
entwine = Entwine(Branch00=crv_3, Branch01=crv, Branch02=crv_2, FlattenInputs=True)

crv_4 = Curve(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)
geometry = Geometry(Outlines=crv_4, Simplify="-100", Hull=False, Copies="100", Offset=Slider(20, range=1..1000))  # -> Geometry, Borders

crv_5 = Curve(entwine)
sheets = Sheets(
    Polylines=crv_5,
    Gap=Slider(10, range=10..100),
    Rows=Slider(20, range=1..20),
    Copies=Slider(20, range=1..1000),
    Offset=Slider(3, range=1..1000))  # -> Sheets, Polylines

opennest2 = OpenNest2(
    Sheets=sheets.Sheets,
    Geometry=geometry.Geometry,
    Iterations=10,
    Run=Toggle(False),
    opt_all_rotations=1,
    opt_element_holes=1,
    opt_font="MecSoft_Font-1 1",
    opt_mutation=10,
    opt_num_of_rotations=8,
    opt_placement_type=1,
    opt_population=10,
    opt_seed=30,
    opt_spacing=0,
    options_expanded=False)  # -> Sheets, Borders, AllGeometry, Transforms, SheetId, SheetTxt, Attributes
