# Grasshopper definition opennest2_1_nest.gh (Grasshopper 1.0.8)
# plug-ins: opennest_2 Info

# ----
# Tutorials: https://www.learn-visual-programming.com/
# 
# Questions: petrasvestartas@gmail.com
# 
# Support my late-night coding with a coffee or beer: https://ko-fi.com/petrasvestartas
crv = Curve(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)
sheets = Sheets(Polylines=crv, Gap=Slider(10, range=10..100), Rows=Slider(20, range=1..20), Copies=Slider(20, range=1..1000))  # -> Sheets, Polylines

crv_2 = Curve(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)
geo = Geometry()
geometry = Geometry(Outlines=crv_2, Simplify="-100", Hull=True, Copies="10", Attributes=geo)  # -> Geometry, Borders

opennest2 = OpenNest2(
    Sheets=sheets.Sheets,
    Geometry=geometry.Geometry,
    Options=["num_of_rotations 4", "wiggle 0", "placement_type 0", "spacing 0.0", "seed 30", "simplify_tolerance 1", "mutation 10", "population 10000", "time 0", "MecSoft_Font-1 10"],
    Iterations=1,
    Run=invert(False))  # -> Sheets, Borders, AllGeo, Transforms, SheetId, SheetTxt, Attributes
