# Grasshopper definition opennest2_1_nest_attributes.gh (Grasshopper 1.0.8)
# plug-ins: opennest_2 Info

# ---- group: Closed outlines (with or without holes)
crv = Curve(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)
crv_2 = Curve([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])
crv_3 = Curve(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)
entwine = Entwine(Branch00=crv_2, Branch01=crv, Branch02=crv_3, FlattenInputs=True)

# ---- group: Attributes Geometries
geo = Geometry(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)
geo_2 = Geometry(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)
geo_3 = Geometry([Point(-811, 529, 0), Point(-713, 532, 0), Point(-716, 471, 0), Point(-751, 448, 0), Point(-808, 450, 0), Point(-803, 490, 0), Point(-772, 515, 0), Point(-731, 498, 0), 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])
entwine_2 = Entwine(Branch00=geo, Branch01=geo_2, Branch02=geo_3, FlattenInputs=True)

# ----
# Tutorials: https://www.learn-visual-programming.com/
# 
# Questions: petrasvestartas@gmail.com
# 
# Support my late-night coding with a coffee or beer: https://ko-fi.com/petrasvestartas
crv_4 = Curve(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)
sheets = Sheets(Polylines=crv_4, Gap=Slider(10, range=10..100), Rows=Slider(20, range=1..20), Copies=Slider(20, range=1..1000))  # -> Sheets, Polylines

# ---- group: Separate your input to a) closed polylines b) attributes e.g. points, lines, meshes and etc. If attributes are used you must use a data-tree for outlines and attributes.
crv_5 = Curve(entwine)
geo_4 = Geometry(entwine_2)
nest_geo = Nest_geo(Outlines=crv_5, Simplify="-100", Hull=Toggle(False), Copies="1", Attributes=geo_4)  # -> Nest_geo, Borders

# ----
opennest2 = OpenNest2(
    Sheets=sheets.Sheets,
    Geometry=nest_geo.Nest_geo,
    Options=["num_of_rotations 4", "wiggle 0", "placement_type 0", "spacing 0.0", "seed 30", "simplify_tolerance 1", "mutation 10", "population 10000", "time 0", "MecSoft_Font-1 10"],
    Iterations=1,
    Run=Toggle(True))  # -> Sheets, Borders, AllGeo, Transforms, SheetId, SheetTxt, Attributes

# ---- group: Attributes are hidden by default.
geometry = Geometry(opennest2.Attributes)
