# Grasshopper definition opennest2_1_nest_attributes_A.gh (Grasshopper 1.0.8)

# ---- group: Closed outlines (with or without holes)
crv = Curve(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)
crv_2 = Curve([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])
crv_3 = Curve(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)
entwine = Entwine(Branch00=crv_2, Branch01=crv, Branch02=crv_3, FlattenInputs=True)

# ---- group: Attributes Geometries
geo = Geometry(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)
geo_2 = Geometry(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)
geo_3 = Geometry([Point(-811, 529, 0), Point(-713, 532, 0), Point(-716, 471, 0), Point(-751, 448, 0), Point(-808, 450, 0), Point(-803, 490, 0), Point(-772, 515, 0), Point(-731, 498, 0), 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])
entwine_2 = Entwine(Branch00=geo, Branch01=geo_2, Branch02=geo_3, FlattenInputs=True)
