# Grasshopper definition opennest2_1_nest_merge_elements.gh (Grasshopper 1.0.8)
# plug-ins: opennest_2 Info

id = Guid([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])
geometry_rhino = GeometryRhino(Layer="a", Copies="2", Simplify=[100, 0], Sort=Slider(0, range=-1..1), Guid=id)  # -> Geometry, Borders, BC, Groups, All

id_2 = Guid([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])
geometry_rhino_2 = GeometryRhino(Layer="b", Copies="1", Simplify=[-1, 1], Sort=Slider(0, range=-1..1), Guid=id_2)  # -> Geometry, Borders, BC, Groups, All

# ----
# Tutorials: https://www.learn-visual-programming.com/
# 
# Questions: petrasvestartas@gmail.com
# 
# Support my late-night coding with a coffee or beer: https://ko-fi.com/petrasvestartas
crv = Curve(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)
sheets = Sheets(Polylines=crv, Gap=0.1)  # -> Sheets, Polylines
merge = Merge(Geometry=geometry_rhino.Geometry, Geometry_2=geometry_rhino_2.Geometry)
opennest2 = OpenNest2(
    Sheets=sheets.Sheets,
    Geometry=merge,
    Options=["num_of_rotations 36", "wiggle 0", "placement_type 0", "spacing 0.0", "seed 30", "simplify_tolerance 1", "mutation 3", "population 10000", "time 0", "MecSoft_Font-1 10"],
    Iterations=Slider(1, range=0..10),
    Run=invert(False))  # -> Sheets, Borders, AllGeometry, Transforms, SheetId, SheetTxt, Attributes
boundary = BoundarySurfaces(Edges=opennest2.Borders)
