# Grasshopper definition opennest2_1_nest_simplify_explanation.gh (Grasshopper 1.0.8)
# plug-ins: opennest_2 Info

# ----
# You can add more divisions,
# because in the nesting step,
# boundary polygon will be computed.
# x > 0 - divides curves, max 10 divisions
# 0 - takes curve ends
# x < 0 - takes three points
# Create a convex-hull for faster nesting:
# Ideally,
# you need to make your own approximation
# and use spacing distance,
# to avoid overlapping.
number_slider = Slider(100, range=-500..1000)

# ----
# Tutorials: https://www.learn-visual-programming.com/
# 
# Questions: petrasvestartas@gmail.com
# 
# Support my late-night coding with a coffee or beer: https://ko-fi.com/petrasvestartas
crv = Curve(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)
sheets = Sheets(Polylines=crv, Gap=Slider(10, range=10..100), Rows=Slider(20, range=1..20), Copies=Slider(20, range=1..1000))  # -> Sheets, Polylines

# ---- group: Separate your input to a) closed polylines b) attributes e.g. points, lines, meshes and etc. If attributes are used you must use a data-tree for outlines and attributes.
crv_2 = Curve(graft(Tree({0;0}: [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], {0;1}: [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], {0;2}: [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])))
geo = Geometry()
panel = Panel(number_slider)
panel_2 = Panel("""5
4
1""")
nest_geo = Nest_geo(Outlines=crv_2, Simplify=panel, Hull=Toggle(False), Copies=panel_2, Attributes=geo)  # -> Nest_geo, Borders

# ----
opennest2 = OpenNest2(
    Sheets=sheets.Sheets,
    Geometry=nest_geo.Nest_geo,
    Options=["num_of_rotations 4", "wiggle 0", "placement_type 0", "spacing 0.0", "seed 30", "simplify_tolerance 1", "mutation 10", "population 10000", "time 0", "MecSoft_Font-1 10"],
    Iterations=1,
    Run=invert(False))  # -> Sheets, Borders, AllGeo, Transforms, SheetId, SheetTxt, Attributes
