# Grasshopper definition opennest2_1_run_solve_n_times.gh (Grasshopper 1.0.8)
# plug-ins: opennest_2 Info

crv = Curve(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)
crv_2 = Curve([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])
crv_3 = Curve([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])
crv_4 = Curve([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])
# Tutorials: https://www.learn-visual-programming.com/
# 
# Questions: petrasvestartas@gmail.com
# 
# Support my late-night coding with a coffee or beer: https://ko-fi.com/petrasvestartas
entwine = Entwine(Branch00=crv_2, Branch01=crv, FlattenInputs=True)
entwine_2 = Entwine(Branch00=crv_3, Branch01=crv_4, FlattenInputs=True)
boundary = BoundarySurfaces(Edges=entwine_2)
boundary_2 = BoundarySurfaces(Edges=entwine)

options = Options(
    Rotations=Slider(4, range=0..360),
    Wiggle=Slider(0, range=0..5.01),
    PlacementType=Slider(2, range=0..2),
    Spacing=Slider(0, range=0..100),
    Seed=Slider(30, range=0..100),
    SimplifyTolerance=Slider(1, range=0.01..10),
    Mutation=Slider(100, range=1..100),
    Population=Slider(34313, range=1..100000),
    Time=Slider(0, range=0..120),
    SheetFont="MecSoft_Font-1 -10")

brep = Brep(boundary_2)
sheets_srf = SheetsSrf(Surfaces=brep, Gap=Slider(10, range=10..100), Rows=Slider(20, range=1..20), Count=Slider(20, range=1..1000))  # -> Sheets, Polylines

brep_2 = Brep(boundary)
geo = Geometry()
geometry_srf = GeometrySrf(Surfaces=brep_2, Simplify="-100", Hull=False, Copies="50", Attributes=geo)  # -> Geometry, Borders

opennest2 = OpenNest2(
    Sheets=sheets_srf.Sheets,
    Geometry=geometry_srf.Geometry,
    Options=options,
    Iterations=Slider(1, range=0..1),
    Run=invert(False))  # -> Sheets, Borders, AllGeo, Transforms, SheetId, SheetTxt, Attributes
