# Grasshopper definition opennest2_1_run_solve_n_times_A.gh (Grasshopper 1.0.8)

crv = Curve(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)
crv_2 = Curve([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])
crv_3 = Curve([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])
crv_4 = Curve([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])
entwine = Entwine(Branch00=crv_2, Branch01=crv, FlattenInputs=True)
entwine_2 = Entwine(Branch00=crv_3, Branch01=crv_4, FlattenInputs=True)
boundary = BoundarySurfaces(Edges=entwine_2)
boundary_2 = BoundarySurfaces(Edges=entwine)
