# Grasshopper definition opennest2_1_sheets_with_holes_A.gh (Grasshopper 1.0.8)

crv = Curve([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])
crv_2 = Curve([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])
crv_3 = Curve(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)
entwine = Entwine(Branch00=crv, Branch01=crv_2, Branch02=crv_3, FlattenInputs=True)
