# Grasshopper definition opennest2_1_timer.gh (Grasshopper 1.0.8)
# plug-ins: opennest_2 Info

crv = Curve(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)
# Tutorials: https://www.learn-visual-programming.com/
# 
# Questions: petrasvestartas@gmail.com
# 
# Support my late-night coding with a coffee or beer: https://ko-fi.com/petrasvestartas
sheets = Sheets(Polylines=crv, Gap=Slider(10, range=10..100), Rows=Slider(20, range=1..20), Copies=Slider(20, range=1..1000))  # -> Sheets, Polylines

crv_2 = Curve([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])

options = Options(
    Rotations=Slider(4, range=0..360),
    Wiggle=Slider(0, range=0..5.01),
    PlacementType=Slider(0, range=0..2),
    Spacing=Slider(0, range=0..100),
    Seed=Slider(30, range=0..100),
    SimplifyTolerance=Slider(1, range=0.01..10),
    Mutation=Slider(10, range=1..100),
    Population=Slider(10000, range=1..100000),
    Time=Slider(5, range=0..120),
    SheetFont="MecSoft_Font-1 -10")

crv_3 = Curve(crv_2)
geo = Geometry()
geometry = Geometry(Outlines=crv_3, Simplify="-100", Hull=False, Copies="1", Attributes=geo)  # -> Geometry, Borders

opennest2 = OpenNest2(Sheets=sheets.Sheets, Geometry=geometry.Geometry, Options=options, Iterations=1, Run=Toggle(True))  # -> Sheets, Borders, AllGeo, Transforms, SheetId, SheetTxt, Attributes
