# Grasshopper definition opennest2_1_timer_A.gh (Grasshopper 1.0.8)
# plug-ins: opennest_2 Info

crv = Curve([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])

options = Options(
    Rotations=Slider(4, range=0..360),
    Wiggle=Slider(0, range=0..5.01),
    PlacementType=Slider(0, range=0..2),
    Spacing=Slider(0, range=0..100),
    Seed=Slider(30, range=0..100),
    SimplifyTolerance=Slider(1, range=0.01..10),
    Mutation=Slider(10, range=1..100),
    Population=Slider(10000, range=1..100000),
    Time=Slider(5, range=0..120),
    SheetFont="MecSoft_Font-1 -10")
