# Grasshopper definition opennest2_2_unroll.gh (Grasshopper 1.0.8)
# plug-ins: opennest_2 Info

# ----
# Unroll simple geometry.
brep = Brep([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])
# Tutorials: https://www.learn-visual-programming.com/
# 
# Questions: petrasvestartas@gmail.com
# 
# Support my late-night coding with a coffee or beer: https://ko-fi.com/petrasvestartas
unroll = Unroll(MeshOrBrep=brep)  # -> Brep, Curves, Points, TextDotsLocation, TextDots

# ----
# Unroll geometry with attributes.
number_slider = Slider(0.5, range=0..1)
pt = ConstructPoint(XCoordinate=number_slider, YCoordinate=number_slider, ZCoordinate=0)
brep_2 = Brep([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])
evalsrf = EvaluateSurface(Surface=reparameterize(brep_2), Point=pt)  # -> Point, Normal, UDirection, VDirection, Frame
lng = ListLength(List=evalsrf.Point)
pl = PlaneNormal(Origin=evalsrf.Point, ZAxis=evalsrf.Normal)
series = Series(Start=0, Step=1, Count=lng)
text = Text(Location=pl, Text=series, Size=Slider(43, range=0..100))
unroll_2 = Unroll(MeshOrBrep=brep_2, Points=evalsrf.Point, Text=series, TextPoint=evalsrf.Point)  # -> Brep, Curves, Points, TextDotsLocation, TextDots
text_2 = Text(Location=unroll_2.TextDotsLocation, Text=unroll_2.TextDots, Size=Slider(43, range=0..100))
geo = Geometry(unroll_2.Brep)

# ----
# Unroll geometry and pack them into a grid.
brep_3 = Brep(graft([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]))
scale = Scale(Geometry=brep_3, Center=Point(0, 0, 0), Factor=Slider(0.01, range=0..0.01))  # -> Geometry, Transform

unroll_3 = Unroll(MeshOrBrep=scale.Geometry)  # -> Brep, Curves, Points, TextDotsLocation, TextDots

brep_4 = Brep(flatten(unroll_3.Brep))
partition = PartitionList(List=brep_4, Size=Slider(10, range=0..10))
area = Area(Geometry=partition)  # -> Area, Centroid
pack = PackObjects(Geo=partition, Plane=area.Centroid, X=Slider(0.01, range=0..0.01), Y=Slider(0.47, range=0..2.01), Tolerabce=0)  # -> Geo, Transformation
