# Grasshopper definition opennest2_3_pack_boxes.gh (Grasshopper 1.0.8)
# plug-ins: opennest_2 Info

# ----
# Pack Geometry by Transformation matrix, third example.
brep = Brep([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])
hull = Hull(Brep=brep)  # -> G, C, H, P0, P1
cp = ControlPoints(Curve=hull.H)  # -> Points, Weights, Knots
hull_2 = ConvexHull(Points=cp.Points, Plane=PlaneXY(0, 0, 0))  # -> Hull, HullZ, Indices
offset = OffsetCurve(Curve=hull_2.Hull, Distance=Slider(19, range=0..100), Plane=PlaneXY(0, 0, 0), Corners=1)  # -> flatten(Curve)
crv = Curve(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)
packbox = PackingBoxes(Con=crv, Geo=offset)  # -> Geo, Tra
transform = Transform(Geometry=hull.G, Transform=graft(packbox.Tra))
debrep = DeconstructBrep(Brep=transform)  # -> Faces, Edges, Vertices
join = JoinCurves(Curves=debrep.Edges, Preserve=False)  # -> flatten(Curves)
len = Length(Curve=join)
larger = LargerThan(FirstNumber=len, SecondNumber=Slider(500, range=0..1000))  # -> LargerThan, OrEqualTo
dispatch = Dispatch(List=join, DispatchPattern=larger.LargerThan)  # -> ListA, ListB
partition = PartitionList(List=dispatch.ListB, Size=2)
area = Area(Geometry=partition)  # -> Area, Centroid
pline = PolyLine(Vertices=area.Centroid, Closed=False)
drilllines = Curve(pline)
cutting_lines = Curve(dispatch.ListA)

# ----
# Pack Boxes
brep_2 = Brep([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])
brep_3 = Brep(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)
# Tutorials: https://www.learn-visual-programming.com/
# 
# Support: petrasvestartas@gmail.com
# 
# Coffee or Beer : https://ko-fi.com/petrasvestartas
packbox_2 = PackingBoxes(Con=brep_3, Geo=brep_2)  # -> Geo, Tra

crv_2 = Curve([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])
crv_3 = Curve([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])

# ----
# Pack Geometry by Transformation matrix, first example.
crv_4 = Curve([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])
packbox_3 = PackingBoxes(Con=crv_4, Geo=crv_2)  # -> Geo, Tra
transform_2 = Transform(Geometry=crv_3, Transform=packbox_3.Tra)

number_slider = Slider(100, range=0..100)
crv_5 = Curve(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)
repeat = RepeatData(Data=crv_5, Length=number_slider)
series = Series(Start=0, Step=1, Count=number_slider)
pop2d = Populate2D(Region=repeat, Count=Slider(10, range=0..10), Seed=series)
hull_3 = ConvexHull(Points=pop2d, Plane=PlaneXY(0, 0, 0))  # -> flatten(Hull), HullZ, Indices

# ----
# Pack Geometry by Transformation matrix, second example.
crv_6 = Curve([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])
packbox_4 = PackingBoxes(Con=crv_6, Geo=hull_3.Hull)  # -> Geo, Tra
transform_3 = Transform(Geometry=hull_3.Hull, Transform=packbox_4.Tra)
