# Grasshopper definition opennest2_4_pack_line_or_grid.gh (Grasshopper 1.0.8)
# plug-ins: opennest_2

# ----
# Pack in a linear array.
crv = Curve([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])
xy = XYPlane(Origin=Point(0, 0, 0))
lng = ListLength(List=crv)
repeat = RepeatData(Data=xy, Length=lng)
# Tutorials: https://www.learn-visual-programming.com/
# 
# Support: petrasvestartas@gmail.com
# 
# Coffee or Beer : https://ko-fi.com/petrasvestartas
pack = PackObjects(Geo=crv, Plane=repeat, X=1, Y=1, Tolerabce=0)  # -> Geo, Transformation

# ----
# Pack in a grid.
crv_2 = Curve([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])
xy_2 = XYPlane(Origin=Point(0, 0, 0))
lng_2 = ListLength(List=crv_2)
repeat_2 = RepeatData(Data=xy_2, Length=lng_2)
partition = PartitionList(List=crv_2, Size=[3, 2])
partition_2 = PartitionList(List=repeat_2, Size=[3, 2])
pack_2 = PackObjects(Geo=partition, Plane=partition_2, X=Slider(61, range=0..1000), Y=Slider(887, range=0..1000), Tolerabce=0)  # -> Geo, Transformation
