# Grasshopper definition opennest2_5_text.gh (Grasshopper 1.0.8)
# plug-ins: opennest_2 Info

# ----
# Tutorials: https://www.learn-visual-programming.com/
# 
# Questions: petrasvestartas@gmail.com
# 
# Support my late-night coding with a coffee or beer: https://ko-fi.com/petrasvestartas
# Single-line text or a text loaded from font.
pop2d = Populate2D(Region={Plane=PlaneXY(0, 0, 0), Size=Domain2(u=0..20, v=0..10)}, Count=100, Seed=1)
pdecon = Deconstruct(Point=pop2d)  # -> XComponent, YComponent, ZComponent
round = Round(Number=pdecon.XComponent)  # -> Nearest, Floor, Ceiling
text = Text(Location=pop2d, Text=round.Nearest, Size=Slider(1, range=0..10))

panel = Panel("calibri False True")
