# Grasshopper definition opennest2_7_projection.gh (Grasshopper 1.0.8)
# plug-ins: opennest_2 Info

# ----
# Tutorials: https://www.learn-visual-programming.com/
# 
# Questions: petrasvestartas@gmail.com
# 
# Support my late-night coding with a coffee or beer: https://ko-fi.com/petrasvestartas
# Orient planar polygon to XY plane and Nest.
crv = Curve([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])
project = Project(Polyline=crv)  # -> Polyline, Plane
pack = PackObjects(Geo=project.Polyline, Plane=project.Plane, X=1, Y=1, Tolerabce=0)  # -> Geo, Transformation

crv_2 = Curve(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)
sheets = Sheets(Polylines=crv_2, Gap=Slider(10, range=10..100), Rows=Slider(20, range=1..20), Copies=Slider(20, range=1..1000))  # -> Sheets, Polylines

crv_3 = Curve(pack.Geo)
geo = Geometry()
geometry = Geometry(Outlines=crv_3, Simplify="-100", Hull=False, Copies="1", Attributes=geo)  # -> Geometry, Borders

opennest2 = OpenNest2(
    Sheets=sheets.Sheets,
    Geometry=geometry.Geometry,
    Options=["num_of_rotations 4", "wiggle 0", "placement_type 0", "spacing 0.0", "seed 30", "simplify_tolerance 1", "mutation 10", "population 10000", "time 0", "MecSoft_Font-1 10"],
    Iterations=1,
    Run=Toggle(True))  # -> Sheets, Borders, AllGeo, Transforms, SheetId, SheetTxt, Attributes
