# Grasshopper definition opennest2_8_bounding_box_edges.gh (Grasshopper 1.0.8)
# plug-ins: opennest_2 Info

# ----
# When you want to measure the bounding area.
brep = Brep(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)
# Tutorials: https://www.learn-visual-programming.com/
# 
# Questions: petrasvestartas@gmail.com
# 
# Support my late-night coding with a coffee or beer: https://ko-fi.com/petrasvestartas
bboxedges = BBoxEdges(Geo=brep)  # -> Line0, Line1, Dist0, Dist1, Box
linedim = LineDimension(Line=[bboxedges.Line0, bboxedges.Line1], Text="{0:0.00}", Size=Slider(20, range=0..100))
