# Grasshopper definition opennest2_9_principal_component_analysis_oriented_bounding_box.gh (Grasshopper 1.0.8)
# plug-ins: opennest_2 Info

# ----
# Principal-component-analysis to get oriented-bounding-box.
# 
# This method is fast and efficient when pointclouds dont
# have symmetries such as a cube or a square box.
number_slider = Slider(1000, range=0..1000)
# Tutorials: https://www.learn-visual-programming.com/
# 
# Questions: petrasvestartas@gmail.com
# 
# Support my late-night coding with a coffee or beer: https://ko-fi.com/petrasvestartas
brep = Brep(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)
popgeo = PopulateGeometry(Geometry=brep, Count=number_slider, Seed=1)
pca = PCA(Points=popgeo)  # -> Plane, Box, Points
