# Grasshopper definition opennest_2_1_nest_legacy.gh (Grasshopper 1.0.8)
# plug-ins: opennest_2 Info

# ---- group: Static
crv = Curve([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])
project = Project(Polyline=crv)  # -> Polyline, Plane
pack = PackObjects(Geo=project.Polyline, Plane=project.Plane, X=1, Y=1, Tolerance=0)  # -> Geo, Transformation
# Tutorials: https://www.learn-visual-programming.com/
# 
# Questions: petrasvestartas@gmail.com
# 
# Support my late-night coding with a coffee or beer: https://ko-fi.com/petrasvestartas
crv_2 = Curve(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)
opennest = OpenNest(
    Sheets=crv_2,
    Geo=pack.Geo,
    Spacing=1,
    Placement=1,
    Tolerance=0.1,
    Rotations=4,
    Iterations=1,
    Seed=1,
    Reset=True,
    Run=Toggle(True))  # -> Sheets, Geo, ID, Transform, IDS

# ---- group: Timer
crv_3 = Curve([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])
crv_4 = Curve(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)
repeat = RepeatData(Data=crv_3, Length=Slider(30, range=0..100))
opennest1 = OpenNest1(
    Sheets=crv_4,
    Geo=repeat,
    Spacing=1,
    Placement=0,
    Tolerance=0.1,
    Rotations=Slider(360, range=0..1000),
    Iterations=Slider(1, range=0..100),
    Seed=1,
    Reset=Button(),
    Run=Toggle(False))  # -> Sheets, Geo, ID, Transform, IDS
crv_5 = Curve(opennest1.Sheets)
