# Grasshopper definition sheet_surface.ghx (Grasshopper 1.0.8)
# plug-ins: opennest_2 Info

sheets = Geometry([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])
crv = Curve([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])
crv_2 = Curve(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)
crv_3 = Curve(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)
crv_4 = Curve(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)
crv_5 = Curve(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)
# Support with a coffee or beer:
# https://ko-fi.com/petrasvestartas
boundary = BoundarySurfaces(Edges=sheets)  # -> flatten(Surfaces)
panel = Panel("""1
100
100
100
1""")
entwine = Entwine(Branch00=crv, Branch01=crv_4, Branch02=crv_2, Branch03=crv_3, Branch04=crv_5, FlattenInputs=True)
repeat = RepeatData(Data=boundary, Length=10)
boundary_2 = BoundarySurfaces(Edges=entwine)  # -> flatten(Surfaces)
pack = PackObjects(Geo=repeat, Plane=repeat, X=1, Y=1, Tolerance=0)  # -> Geo, Transformation
geometry_srf = GeometrySurfaces(Surfaces=boundary_2, Simplify=-100, Hull=False, Copies=panel, Offset=0)  # -> Geometry, Borders
sheets_srf = SheetsSurfaces(Surfaces=pack.Geo, Gap=0.1, Offset=Slider(2, range=0..100))  # -> Sheets, Polylines
opennestcollision = OpenNestCollision(
    Sheets=sheets_srf.Sheets,
    Geometry=geometry_srf.Geometry,
    Iterations=Slider(100, range=0..100),
    opt_compact=1,
    opt_element_holes=2,
    opt_fit=1,
    opt_font="MecSoft_Font-1 1",
    opt_num_of_rotations=3600,
    opt_poles=48,
    opt_seed=100,
    opt_starts=1,
    options_expanded=True)  # -> Sheets, Borders, AllGeometry, Transforms, SheetId, SheetTxt, Attributes
to_nest = Geometry([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])
crv_6 = Curve(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)
manual_nesting = Geometry([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])
