# Grasshopper definition transform_object.ghx (Grasshopper 1.0.8)
# plug-ins: opennest_2 Info

Z = UnitZ(Factor=Slider(10, range=0..10))
# Support with a coffee or beer:
# https://ko-fi.com/petrasvestartas
id = Guid(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)
move = Move(Motion=Z)  # -> Geometry, Transform
tguid = TransformObject(Guid=id, Transform=move.Transform, Run=Toggle(True))
